# Dynamo graph replacer.dyn (Dynamo 0.9.0.3067)

family_types = FamilyTypes("BCRA_Break Line:BCRA_Break Line")
all_elements_of_family_type = ElementsOfFamilyType(family_types)
facingOrientation = FamilyInstance.FacingOrientation(all_elements_of_family_type)
family_types_2 = FamilyTypes("b.Breakline-zigzag-open:b.Breakline-zigzag-open")
all_elements_of_family_type_2 = ElementsOfFamilyType(family_types_2)
facingOrientation_2 = FamilyInstance.FacingOrientation(all_elements_of_family_type_2)
elementLocation = Custom[ElementLocation](element=all_elements_of_family_type_2)  # Returns the location of an element as an XYZ (or if it's line-based the start and end point of the line), along with some booleans to help filtering the results. Use this for some element types (e.g. walls or lines) that do not work with the built-in Get Family Instance Location node.
watch = Watch(elementLocation.curveEndpoints)
categories = Categories("Views")
all_elements_of_category = ElementsOfCategory(categories)
categories_2 = Categories("DetailComponents")
all_view_dependent_family = Custom[All View-Dependent Family Instances Of Category](category=categories_2, view=all_elements_of_category)  # Gets all view-dependent family instances in a given view for a given list of categories - useful for finding annotation elements
code_block = CodeBlock { 1; }
flatten = List.Flatten(list=all_view_dependent_family, amt=code_block)
select_model_element = DSModelElementSelection()  # 1 picked in the model
containsItem = List.ContainsItem(item=select_model_element)
map = List.Map(list=flatten, f_x=containsItem)
filterByBoolMask = List.FilterByBoolMask(list=all_elements_of_category, mask=map)
firstItem = List.FirstItem(filterByBoolMask.in)
getViewOfElement = Custom[GetViewOfElement](element=select_model_element)  # Get the view in which a detail item is placed
elementLocation_2 = Custom[ElementLocation](element=all_elements_of_family_type)
XAxis = Vector.XAxis()
XY = Plane.XY()
radiansToDegrees = Math.RadiansToDegrees(elementLocation_2.rotation)
rotate = Vector.Rotate(XAxis, XY, radiansToDegrees)
reverse = Vector.Reverse(rotate)
string = StringInput("Left")
getParameterValueByName = Element.GetParameterValueByName(element=all_elements_of_family_type, parameterName=string)
translate = Geometry.Translate(geometry=elementLocation_2.points, direction=reverse, distance=getParameterValueByName)
string_2 = StringInput("Right")
getParameterValueByName_2 = Element.GetParameterValueByName(element=all_elements_of_family_type, parameterName=string_2)
translate_2 = Geometry.Translate(geometry=elementLocation_2.points, direction=rotate, distance=getParameterValueByName_2)
byStartPointEndPoint = Line.ByStartPointEndPoint(startPoint=translate, endPoint=translate_2)
family_types_3 = FamilyTypes("b.Breakline-zigzag-open:b.Breakline-zigzag-open")
getViewOfElement_2 = Custom[GetViewOfElement]()
map_2 = List.Map(list=all_elements_of_family_type, f_x=getViewOfElement_2)
byCurve = Custom[DetailComponent.ByCurve](curve=byStartPointEndPoint, familyType=family_types_3, view=map_2)  # Places a line-based detail component in a given view
